# Dynamo graph truss Figure 1 gd.dyn (Dynamo 2.16.1.2727)

# group: 하단 장변
byCoordinates = Point.ByCoordinates()
code_block = CodeBlock { 1000; }
byCoordinates_2 = Point.ByCoordinates(x=code_block)
byStartPointEndPoint = Line.ByStartPointEndPoint(startPoint=byCoordinates, endPoint=byCoordinates_2)
code_block_2 = CodeBlock { 0..1..0.2; }
pointAtParameter = Curve.PointAtParameter(curve=byStartPointEndPoint, param=code_block_2)

# group: Input
integer_slider = IntegerSlider(83, range=0..100 step 1)  # graph input

# group: Z 값 Shuffle
code_block_3 = CodeBlock { 0..200..50; }
code_block_4 = CodeBlock { 20; }
ofRepeatedItem = List.OfRepeatedItem(item=code_block_3, amount=code_block_4)
flatten = List.Flatten(list=ofRepeatedItem)
shuffle = List.Shuffle(list=flatten, seed=integer_slider)

# group: 프레임 생성
translate = Geometry.Translate(geometry=pointAtParameter, zTranslation=shuffle)
code_block_5 = CodeBlock { -1; }
dropItems = List.DropItems(list=translate, amount=code_block_5)
code_block_6 = CodeBlock { 1; }
dropItems_2 = List.DropItems(list=translate, amount=code_block_6)
byStartPointEndPoint_2 = Line.ByStartPointEndPoint(startPoint=dropItems_2, endPoint=translate)
byStartPointEndPoint_3 = Line.ByStartPointEndPoint(startPoint=pointAtParameter, endPoint=dropItems_2)
dropItems_3 = List.DropItems(list=pointAtParameter, amount=code_block_6)
byStartPointEndPoint_4 = Line.ByStartPointEndPoint(startPoint=translate, endPoint=dropItems_3)
byStartPointEndPoint_5 = Line.ByStartPointEndPoint(startPoint=pointAtParameter, endPoint=translate)
list_create = List.Create(item0=byStartPointEndPoint_2, item1=byStartPointEndPoint_3, item2=byStartPointEndPoint_4, item3=byStartPointEndPoint_5)
flatten_2 = List.Flatten(list=list_create)

# group: 분절, 접합 점 추출
startPoint = Curve.StartPoint(curve=flatten_2)
endPoint = Curve.EndPoint(curve=flatten_2)
join = List.Join(list0=startPoint, list1=endPoint)
boolean = BoolSelector(false)
clean = List.Clean(list=join, preserveIndices=boolean)
uniqueItems = List.UniqueItems(list=clean)
code_block_7 = CodeBlock { 10; }
byCenterPointRadius = Sphere.ByCenterPointRadius(centerPoint=uniqueItems, radius=code_block_7)
byGeometry = BoundingBox.ByGeometry(geom=byCenterPointRadius@L1)
contains = BoundingBox.Contains(boundingBox=byGeometry, point=clean, lacing=CrossProduct)
filterByBoolMask = List.FilterByBoolMask(list=clean, mask=contains@L2)
watch = Watch(filterByBoolMask.in)

color_palette = ColorPalette({R: 192, G: 192, B: 192, A: 255})
color_palette_2 = ColorPalette({R: 222, G: 184, B: 135, A: 255})
color_palette_3 = ColorPalette({R: 218, G: 165, B: 32, A: 255})
color_palette_4 = ColorPalette({R: 255, G: 215, B: 0, A: 255})
color_palette_5 = ColorPalette({R: 250, G: 128, B: 114, A: 255})
color_palette_6 = ColorPalette({R: 255, G: 0, B: 0, A: 255})
color_palette_7 = ColorPalette({R: 255, G: 69, B: 0, A: 255})
join_2 = List.Join(list0=color_palette, list1=color_palette_2, list2=color_palette_3, list3=color_palette_4, list4=color_palette_5, list5=color_palette_6, list6=color_palette_7)

# group: Dictionary 생성 및 추출
code_block_8 = CodeBlock { 1..7; }
string_from_object = FromObject(object=code_block_8)
byKeysValues = DesignScript.Builtin.Dictionary.ByKeysValues(keys=string_from_object, values=join_2)
count = List.Count(list=watch@L2)
string_from_object_2 = FromObject(object=count)
watch_2 = Watch(string_from_object_2)
valueAtKey = DesignScript.Builtin.Dictionary.ValueAtKey(dictionary=byKeysValues, key=watch_2)

# group: Color
byGeometryColor = Modifiers.GeometryColor.ByGeometryColor(geometry=byCenterPointRadius, color=valueAtKey)

# group: 점수 Out put
sum = Math.Sum(values=count)
count_2 = List.Count(list=count)
code_block_9 = CodeBlock(a=sum, b=count_2) { a/b; }
점수 = List.FirstItem(list=code_block_9)  # graph output
