# Dynamo graph truss Figure 2 gd.dyn (Dynamo 2.16.1.2727)

# group: 기준 Line
byCoordinates = Point.ByCoordinates()
code_block = CodeBlock { 1000; }
byCoordinates_2 = Point.ByCoordinates(x=code_block)
byStartPointEndPoint = Line.ByStartPointEndPoint(startPoint=byCoordinates, endPoint=byCoordinates_2)

# group: CONTROL PANEL
divisions = IntegerSlider(8, range=3..8 step 1)  # graph input
z_component_변수 = IntegerSlider(190, range=100..300 step 30)  # graph input
top_chord_size = IntegerSlider(40, range=10..50 step 10)  # graph input
bottom_chord_size = IntegerSlider(40, range=10..50 step 10)  # graph input
diagonal_chord_size = IntegerSlider(40, range=10..50 step 10)  # graph input
vertical_chord_size = IntegerSlider(40, range=10..50 step 10)  # graph input

# group: 기준 Point 정리
startPoint = Curve.StartPoint(curve=byStartPointEndPoint)
pointsAtEqualSegmentLength = Curve.PointsAtEqualSegmentLength(curve=byStartPointEndPoint, divisions=divisions)
endPoint = Curve.EndPoint(curve=byStartPointEndPoint)
join = List.Join(list0=startPoint, list1=pointsAtEqualSegmentLength, list2=endPoint)
translate = Geometry.Translate(geometry=join, zTranslation=z_component_변수)
code_block_2 = CodeBlock { -1; }
dropItems = List.DropItems(list=translate, amount=code_block_2)
code_block_3 = CodeBlock { 1; -1; 2; }
dropItems_2 = List.DropItems(list=dropItems, amount=code_block_3.out0)
dropItems_3 = List.DropItems(list=dropItems, amount=code_block_3.out2)
code_block_4 = CodeBlock { 1; }
dropItems_4 = List.DropItems(list=translate, amount=code_block_4)
dropItems_5 = List.DropItems(list=dropItems_4, amount=code_block_3.out1)
dropItems_6 = List.DropItems(list=join, amount=code_block_4)

byStartPointEndPoint_2 = Line.ByStartPointEndPoint(startPoint=dropItems_2, endPoint=dropItems_3)
byStartPointEndPoint_3 = Line.ByStartPointEndPoint(startPoint=join, endPoint=dropItems_5)
count = List.Count(list=byStartPointEndPoint_3)
code_block_5 = CodeBlock(a=count) { -(a/2); }
ceiling = Math.Ceiling(number=code_block_5)
dropItems_7 = List.DropItems(list=byStartPointEndPoint_3, amount=ceiling)
byStartPointEndPoint_4 = Line.ByStartPointEndPoint(startPoint=translate, endPoint=dropItems_6)
count_2 = List.Count(list=byStartPointEndPoint_4)
code_block_6 = CodeBlock(a=count_2) { a/2; }
ceiling_2 = Math.Ceiling(number=code_block_6)
dropItems_8 = List.DropItems(list=byStartPointEndPoint_4, amount=ceiling_2)
byStartPointEndPoint_5 = Line.ByStartPointEndPoint(startPoint=join, endPoint=translate)
code_block_7 = CodeBlock { 1; -1; }
dropItems_9 = List.DropItems(list=byStartPointEndPoint_5, amount=code_block_7.out0)
dropItems_10 = List.DropItems(list=dropItems_9, amount=code_block_7.out1)

# group: 트러스 Point 정리
list_create = List.Create(item0=byStartPointEndPoint_2, item1=dropItems_7, item2=dropItems_8, item3=dropItems_10)
flatten = List.Flatten(list=list_create)
startPoint_2 = Curve.StartPoint(curve=flatten)
endPoint_2 = Curve.EndPoint(curve=flatten)
join_2 = List.Join(list0=startPoint_2, list1=endPoint_2)
boolean = BoolSelector(false)
clean = List.Clean(list=join_2, preserveIndices=boolean)
uniqueItems = List.UniqueItems(list=clean)
code_block_8 = CodeBlock { 10; }
byCenterPointRadius = Sphere.ByCenterPointRadius(centerPoint=uniqueItems, radius=code_block_8)
byGeometry = BoundingBox.ByGeometry(geom=byCenterPointRadius@L1)
contains = BoundingBox.Contains(boundingBox=byGeometry, point=clean, lacing=CrossProduct)
filterByBoolMask = List.FilterByBoolMask(list=clean, mask=contains@L2)
watch = Watch(filterByBoolMask.in)

# group: Color
code_block_9 = CodeBlock { 1..7; }
string_from_object = FromObject(object=code_block_9)
color_palette = ColorPalette({R: 192, G: 192, B: 192, A: 255})
color_palette_2 = ColorPalette({R: 222, G: 184, B: 135, A: 255})
color_palette_3 = ColorPalette({R: 218, G: 165, B: 32, A: 255})
color_palette_4 = ColorPalette({R: 255, G: 215, B: 0, A: 255})
color_palette_5 = ColorPalette({R: 250, G: 128, B: 114, A: 255})
color_palette_6 = ColorPalette({R: 255, G: 0, B: 0, A: 255})
color_palette_7 = ColorPalette({R: 255, G: 69, B: 0, A: 255})
join_3 = List.Join(list0=color_palette, list1=color_palette_2, list2=color_palette_3, list3=color_palette_4, list4=color_palette_5, list5=color_palette_6, list6=color_palette_7)
byKeysValues = DesignScript.Builtin.Dictionary.ByKeysValues(keys=string_from_object, values=join_3)
count_3 = List.Count(list=watch@L2)
string_from_object_2 = FromObject(object=count_3)
valueAtKey = DesignScript.Builtin.Dictionary.ValueAtKey(dictionary=byKeysValues, key=string_from_object_2)
byGeometryColor = Modifiers.GeometryColor.ByGeometryColor(geometry=byCenterPointRadius, color=valueAtKey)

# group: Output 점수
sum = Math.Sum(values=count_3)
count_4 = List.Count(list=count_3)
code_block_10 = CodeBlock(a=sum, b=count_4) { a/b; }
점수 = List.FirstItem(list=code_block_10)  # graph output

# group: 형상 Surface
code_block_11 = CodeBlock(a=top_chord_size) { -a; }
translate_2 = Geometry.Translate(geometry=byStartPointEndPoint_2, zTranslation=code_block_11)
list_create_2 = List.Create(item0=byStartPointEndPoint_2, item1=translate_2)
transpose = List.Transpose(lists=list_create_2)
byLoft = Surface.ByLoft(crossSections=transpose)

watch_2 = Watch(byStartPointEndPoint)
flatten_2 = List.Flatten(list=watch_2)

# group: 형상 Surface
code_block_12 = CodeBlock(a=bottom_chord_size) { -a; }
translate_3 = Geometry.Translate(geometry=flatten_2, zTranslation=code_block_12)
list_create_3 = List.Create(item0=flatten_2, item1=translate_3)
transpose_2 = List.Transpose(lists=list_create_3)
byLoft_2 = Surface.ByLoft(crossSections=transpose_2)

# group: 형상 Surface
byTwoPoints = Vector.ByTwoPoints(start=dropItems_6, end=dropItems_5)
YAxis = Vector.YAxis()
code_block_13 = CodeBlock { 90; }
rotate = Vector.Rotate(vector=byTwoPoints, axis=YAxis, degrees=code_block_13)
code_block_14 = CodeBlock(a=diagonal_chord_size) { a; }
translate_4 = Geometry.Translate(geometry=dropItems_7, direction=rotate, distance=code_block_14)
list_create_4 = List.Create(item0=dropItems_7, item1=translate_4)
transpose_3 = List.Transpose(lists=list_create_4)
byLoft_3 = Surface.ByLoft(crossSections=transpose_3)

# group: 형상 Surface
byTwoPoints_2 = Vector.ByTwoPoints(start=translate, end=dropItems_6)
YAxis_2 = Vector.YAxis()
code_block_15 = CodeBlock { 90; }
rotate_2 = Vector.Rotate(vector=byTwoPoints_2, axis=YAxis_2, degrees=code_block_15)
code_block_16 = CodeBlock(a=diagonal_chord_size) { a; }
translate_5 = Geometry.Translate(geometry=dropItems_8, direction=rotate_2, distance=code_block_16)
list_create_5 = List.Create(item0=dropItems_8, item1=translate_5)
transpose_4 = List.Transpose(lists=list_create_5)
byLoft_4 = Surface.ByLoft(crossSections=transpose_4)

# group: 형상 Surface
code_block_17 = CodeBlock(a=vertical_chord_size) { a; }
translate_6 = Geometry.Translate(geometry=dropItems_10, xTranslation=code_block_17)
list_create_6 = List.Create(item0=dropItems_10, item1=translate_6)
transpose_5 = List.Transpose(lists=list_create_6)
byLoft_5 = Surface.ByLoft(crossSections=transpose_5)

# group: 구조 표현 형상
list_create_7 = List.Create(item0=byLoft, item1=byLoft_2, item2=byLoft_3, item3=byLoft_4, item4=byLoft_5)
flatten_3 = List.Flatten(list=list_create_7)
thicken = Surface.Thicken(surface=flatten_3)
boolean_2 = BoolSelector(false)
clean_2 = List.Clean(list=thicken, preserveIndices=boolean_2)

# group: Color
code_block_18 = CodeBlock { 150; }
byARGB = Color.ByARGB(alpha=code_block_18, blue=code_block_18)
byGeometryColor_2 = Modifiers.GeometryColor.ByGeometryColor(geometry=clean_2, color=byARGB)

# group: truss 형상
list_create_8 = List.Create(item0=byStartPointEndPoint, item1=byStartPointEndPoint_2, item2=dropItems_7, item3=dropItems_8, item4=dropItems_10)
code_block_19 = CodeBlock { 5; -5; }
translate_7 = Geometry.Translate(geometry=list_create_8, zTranslation=code_block_19.out0)
flatten_4 = List.Flatten(list=translate_7)
translate_8 = Geometry.Translate(geometry=list_create_8, zTranslation=code_block_19.out1)
flatten_5 = List.Flatten(list=translate_8)
list_create_9 = List.Create(item0=flatten_4, item1=flatten_5)
transpose_6 = List.Transpose(lists=list_create_9)
byLoft_6 = Surface.ByLoft(crossSections=transpose_6)
code_block_20 = CodeBlock { 3; }
thicken_2 = Surface.Thicken(surface=byLoft_6, thickness=code_block_20)
code_block_21 = CodeBlock { 5; -5; }
translate_9 = Geometry.Translate(geometry=list_create_8, xTranslation=code_block_21.out0)
flatten_6 = List.Flatten(list=translate_9)
translate_10 = Geometry.Translate(geometry=list_create_8, xTranslation=code_block_21.out1)
flatten_7 = List.Flatten(list=translate_10)
list_create_10 = List.Create(item0=flatten_6, item1=flatten_7)
transpose_7 = List.Transpose(lists=list_create_10)
byLoft_7 = Surface.ByLoft(crossSections=transpose_7)
code_block_22 = CodeBlock { 3; }
thicken_3 = Surface.Thicken(surface=byLoft_7, thickness=code_block_22)
join_4 = List.Join(list0=thicken_2, list1=thicken_3)

# group: Color
code_block_23 = CodeBlock { 150; }
byARGB_2 = Color.ByARGB(alpha=code_block_23, red=code_block_23)
byGeometryColor_3 = Modifiers.GeometryColor.ByGeometryColor(geometry=join_4, color=byARGB_2)

# group: TOP
code_block_24 = CodeBlock {  }
code_block_25 = CodeBlock {  }

# group: Diagonal
code_block_26 = CodeBlock {  }
code_block_27 = CodeBlock {  }

# group: Vertical
code_block_28 = CodeBlock {  }
code_block_29 = CodeBlock {  }

# group: Bottom
code_block_30 = CodeBlock {  }
code_block_31 = CodeBlock {  }
