# Dynamo graph truss Figure 3 gd.dyn (Dynamo 2.16.1.2727)

# group: 기준 Line
byCoordinates = Point.ByCoordinates()
code_block = CodeBlock { 5000; }
byCoordinates_2 = Point.ByCoordinates(x=code_block)
byStartPointEndPoint = Line.ByStartPointEndPoint(startPoint=byCoordinates, endPoint=byCoordinates_2)

# group: CONTROL PANEL
divisions = IntegerSlider(9, range=5..20 step 1)  # graph input
z_component_변수 = IntegerSlider(460, range=100..500 step 30)  # graph input
top_chord_size = IntegerSlider(40, range=10..50 step 10)  # graph input
bottom_chord_size = IntegerSlider(40, range=10..50 step 10)  # graph input
diagonal_chord_size = IntegerSlider(40, range=10..50 step 10)  # graph input
vertical_chord_size = IntegerSlider(40, range=10..50 step 10)  # graph input

# group: 기준 Points 정리
startPoint = Curve.StartPoint(curve=byStartPointEndPoint)
pointsAtEqualSegmentLength = Curve.PointsAtEqualSegmentLength(curve=byStartPointEndPoint, divisions=divisions)
endPoint = Curve.EndPoint(curve=byStartPointEndPoint)
join = List.Join(list0=startPoint, list1=pointsAtEqualSegmentLength, list2=endPoint)
code_block_2 = CodeBlock { 0..1500..50; }
code_block_3 = CodeBlock { 10; }
ofRepeatedItem = List.OfRepeatedItem(item=code_block_2, amount=code_block_3)
flatten = List.Flatten(list=ofRepeatedItem)
곡선계수 = IntegerSlider(50, range=0..100 step 1)  # graph input
shuffle = List.Shuffle(list=flatten, seed=곡선계수)
code_block_4 = CodeBlock(A=z_component_변수, B=shuffle) { A+B; }
translate = Geometry.Translate(geometry=join, zTranslation=code_block_4)
watch = Watch(translate)
code_block_5 = CodeBlock(a=divisions) { a+1; }
code_block_6 = CodeBlock { 3; }
code_block_7 = CodeBlock(n=code_block_5, deg=code_block_6) { x = Math.RandomList(n) * 100; y = Math.RandomList(n) * 100; W = List.OfRepeatedItem(1,n); kN = n + deg + 1; 0..kN; }
watch_2 = Watch(code_block_7.W)
watch_3 = Watch(code_block_7.out4)
byControlPointsWeightsKnots = NurbsCurve.ByControlPointsWeightsKnots(points=watch, weights=watch_2, knots=watch_3, degree=code_block_6)
maximumItem = List.MaximumItem(list=shuffle)
code_block_8 = CodeBlock(a=maximumItem) { a+1000; }
translate_2 = Geometry.Translate(geometry=join, zTranslation=code_block_8)
byStartPointEndPoint_2 = Line.ByStartPointEndPoint(startPoint=translate_2, endPoint=join)
intersectAll = Geometry.IntersectAll(geometry=byControlPointsWeightsKnots, others=byStartPointEndPoint_2, lacing=Longest)
flatten_2 = List.Flatten(list=intersectAll)
code_block_9 = CodeBlock { 1; -1; 2; }
dropItems = List.DropItems(list=flatten_2, amount=code_block_9.out1)
code_block_10 = CodeBlock { 1; }
dropItems_2 = List.DropItems(list=join, amount=code_block_10)
dropItems_3 = List.DropItems(list=flatten_2, amount=code_block_9.out0)

watch_4 = Watch(byControlPointsWeightsKnots)
splitByPoints = Curve.SplitByPoints(curve=watch_4, points=flatten_2)
byStartPointEndPoint_3 = Line.ByStartPointEndPoint(startPoint=join, endPoint=dropItems)
count = List.Count(list=byStartPointEndPoint_3)
code_block_11 = CodeBlock(a=count) { -(a/2); }
ceiling = Math.Ceiling(number=code_block_11)
dropItems_4 = List.DropItems(list=byStartPointEndPoint_3, amount=ceiling)
byStartPointEndPoint_4 = Line.ByStartPointEndPoint(startPoint=flatten_2, endPoint=dropItems_2)
byStartPointEndPoint_5 = Line.ByStartPointEndPoint(startPoint=join, endPoint=flatten_2, lacing=Longest)
code_block_12 = CodeBlock { 1; -1; }
dropItems_5 = List.DropItems(list=byStartPointEndPoint_5, amount=code_block_12.out0)
list_create = List.Create(item0=splitByPoints, item1=dropItems_4, item2=byStartPointEndPoint_4, item3=dropItems_5)
flatten_3 = List.Flatten(list=list_create)
startPoint_2 = Curve.StartPoint(curve=flatten_3)
endPoint_2 = Curve.EndPoint(curve=flatten_3)
join_2 = List.Join(list0=startPoint_2, list1=endPoint_2)
boolean = BoolSelector(false)
clean = List.Clean(list=join_2, preserveIndices=boolean)
uniqueItems = List.UniqueItems(list=clean)
code_block_13 = CodeBlock { 10; }
byCenterPointRadius = Sphere.ByCenterPointRadius(centerPoint=uniqueItems, radius=code_block_13)
byGeometry = BoundingBox.ByGeometry(geom=byCenterPointRadius@L1)
contains = BoundingBox.Contains(boundingBox=byGeometry, point=clean, lacing=CrossProduct)
filterByBoolMask = List.FilterByBoolMask(list=clean, mask=contains@L2)
watch_5 = Watch(filterByBoolMask.in)

# group: color
code_block_14 = CodeBlock { 1..7; }
string_from_object = FromObject(object=code_block_14)
color_palette = ColorPalette({R: 192, G: 192, B: 192, A: 255})
color_palette_2 = ColorPalette({R: 222, G: 184, B: 135, A: 255})
color_palette_3 = ColorPalette({R: 218, G: 165, B: 32, A: 255})
color_palette_4 = ColorPalette({R: 255, G: 215, B: 0, A: 255})
color_palette_5 = ColorPalette({R: 250, G: 128, B: 114, A: 255})
color_palette_6 = ColorPalette({R: 255, G: 0, B: 0, A: 255})
color_palette_7 = ColorPalette({R: 255, G: 69, B: 0, A: 255})
join_3 = List.Join(list0=color_palette, list1=color_palette_2, list2=color_palette_3, list3=color_palette_4, list4=color_palette_5, list5=color_palette_6, list6=color_palette_7)
byKeysValues = DesignScript.Builtin.Dictionary.ByKeysValues(keys=string_from_object, values=join_3)
count_2 = List.Count(list=watch_5@L2)
string_from_object_2 = FromObject(object=count_2)
valueAtKey = DesignScript.Builtin.Dictionary.ValueAtKey(dictionary=byKeysValues, key=string_from_object_2)
byGeometryColor = Modifiers.GeometryColor.ByGeometryColor(geometry=byCenterPointRadius, color=valueAtKey)
sum = Math.Sum(values=count_2)
count_3 = List.Count(list=count_2)
code_block_15 = CodeBlock(a=sum, b=count_3) { a/b; }
점수 = List.FirstItem(list=code_block_15)  # graph output

# group: 형상 Surface
code_block_16 = CodeBlock(a=top_chord_size) { -a; }
translate_3 = Geometry.Translate(geometry=splitByPoints, zTranslation=code_block_16)
list_create_2 = List.Create(item0=splitByPoints, item1=translate_3)
transpose = List.Transpose(lists=list_create_2)
byLoft = Surface.ByLoft(crossSections=transpose)

watch_6 = Watch(byStartPointEndPoint)
flatten_4 = List.Flatten(list=watch_6)

# group: 형상 Surface
code_block_17 = CodeBlock(a=bottom_chord_size) { -a; }
translate_4 = Geometry.Translate(geometry=flatten_4, zTranslation=code_block_17)
list_create_3 = List.Create(item0=flatten_4, item1=translate_4)
transpose_2 = List.Transpose(lists=list_create_3)
byLoft_2 = Surface.ByLoft(crossSections=transpose_2)

# group: 형상 Surface
byTwoPoints = Vector.ByTwoPoints(start=dropItems_2, end=dropItems)
YAxis = Vector.YAxis()
code_block_18 = CodeBlock { 90; }
rotate = Vector.Rotate(vector=byTwoPoints, axis=YAxis, degrees=code_block_18)
code_block_19 = CodeBlock(a=diagonal_chord_size) { a; }
translate_5 = Geometry.Translate(geometry=dropItems_4, direction=rotate, distance=code_block_19)
list_create_4 = List.Create(item0=dropItems_4, item1=translate_5)
transpose_3 = List.Transpose(lists=list_create_4)
byLoft_3 = Surface.ByLoft(crossSections=transpose_3)

# group: 형상 Surface
byTwoPoints_2 = Vector.ByTwoPoints(start=flatten_2, end=dropItems_2)
YAxis_2 = Vector.YAxis()
code_block_20 = CodeBlock { 90; }
rotate_2 = Vector.Rotate(vector=byTwoPoints_2, axis=YAxis_2, degrees=code_block_20)
code_block_21 = CodeBlock(a=diagonal_chord_size) { a; }
translate_6 = Geometry.Translate(geometry=byStartPointEndPoint_4, direction=rotate_2, distance=code_block_21)
list_create_5 = List.Create(item0=byStartPointEndPoint_4, item1=translate_6)
transpose_4 = List.Transpose(lists=list_create_5)
byLoft_4 = Surface.ByLoft(crossSections=transpose_4)

# group: 형상 Surface
code_block_22 = CodeBlock(a=vertical_chord_size) { a; }
translate_7 = Geometry.Translate(geometry=dropItems_5, xTranslation=code_block_22)
list_create_6 = List.Create(item0=dropItems_5, item1=translate_7)
transpose_5 = List.Transpose(lists=list_create_6)
byLoft_5 = Surface.ByLoft(crossSections=transpose_5)

# group: 형상 Solids
list_create_7 = List.Create(item0=byLoft, item1=byLoft_2, item2=byLoft_3, item3=byLoft_4, item4=byLoft_5)
flatten_5 = List.Flatten(list=list_create_7)
thicken = Surface.Thicken(surface=flatten_5)
boolean_2 = BoolSelector(false)
clean_2 = List.Clean(list=thicken, preserveIndices=boolean_2)

# group: Color
code_block_23 = CodeBlock { 150; }
byARGB = Color.ByARGB(alpha=code_block_23, blue=code_block_23)
byGeometryColor_2 = Modifiers.GeometryColor.ByGeometryColor(geometry=clean_2, color=byARGB)

# group: 형상 Solids
list_create_8 = List.Create(item0=byStartPointEndPoint, item1=splitByPoints, item2=dropItems_4, item3=byStartPointEndPoint_4, item4=dropItems_5)
code_block_24 = CodeBlock { 5; -5; }
translate_8 = Geometry.Translate(geometry=list_create_8, zTranslation=code_block_24.out0)
flatten_6 = List.Flatten(list=translate_8)
translate_9 = Geometry.Translate(geometry=list_create_8, zTranslation=code_block_24.out1)
flatten_7 = List.Flatten(list=translate_9)
list_create_9 = List.Create(item0=flatten_6, item1=flatten_7)
transpose_6 = List.Transpose(lists=list_create_9)
byLoft_6 = Surface.ByLoft(crossSections=transpose_6)
code_block_25 = CodeBlock { 3; }
thicken_2 = Surface.Thicken(surface=byLoft_6, thickness=code_block_25)
code_block_26 = CodeBlock { 5; -5; }
translate_10 = Geometry.Translate(geometry=list_create_8, xTranslation=code_block_26.out0)
flatten_8 = List.Flatten(list=translate_10)
translate_11 = Geometry.Translate(geometry=list_create_8, xTranslation=code_block_26.out1)
flatten_9 = List.Flatten(list=translate_11)
list_create_10 = List.Create(item0=flatten_8, item1=flatten_9)
transpose_7 = List.Transpose(lists=list_create_10)
byLoft_7 = Surface.ByLoft(crossSections=transpose_7)
code_block_27 = CodeBlock { 3; }
thicken_3 = Surface.Thicken(surface=byLoft_7, thickness=code_block_27)
join_4 = List.Join(list0=thicken_2, list1=thicken_3)

# group: color
code_block_28 = CodeBlock { 150; }
byARGB_2 = Color.ByARGB(alpha=code_block_28, red=code_block_28)
byGeometryColor_3 = Modifiers.GeometryColor.ByGeometryColor(geometry=join_4, color=byARGB_2)

# group: TOP
code_block_29 = CodeBlock {  }
code_block_30 = CodeBlock {  }

# group: Diagonal
code_block_31 = CodeBlock {  }
code_block_32 = CodeBlock {  }

# group: Vertical
code_block_33 = CodeBlock {  }
code_block_34 = CodeBlock {  }

# group: Bottom
code_block_35 = CodeBlock {  }
code_block_36 = CodeBlock {  }

dropItems_6 = List.DropItems(list=byStartPointEndPoint_5, amount=code_block_12.out1)
